test file "Test_LKAS"

suite "LKAS_SIL"

  case "LKAS_SIL_Demo" [equivalence]
    simulation 1:
      model LKAS, harness LKAS_Harness (for LKAS/LKAS/LL), stop time 90
      input "1.mat" (active)
      input "2.mat"
      input "3.mat"
    simulation 2:
      model LKAS_TEST2, mode Software-in-the-Loop (SIL), stop time 90
      input "1.mat" (active)
      input "2.mat"
      input "3.mat"
    equivalence criteria
      LKASve_y_Vehicle_Lane_Display
      LKASve_y_LDW_Status_Display
      LKASve_y_EPS_LKA_Control
      LKASve_y_LKA_Status_Display
      LKASve_y_LDW_Flag
      LKASve_y_Hands_Off_Warning
      LKASve_y_LKA_Action_Indication
      LKASve_y_HMI_Popup_Status
      LKASve_y_EPS_State_Control
      LKASve_g_LKA_SWA_Control
      LKASve_g_EPS_Factor_Control
    iterations:
      Iteration1: ExternalInput "1.mat", ExternalInput "1.mat"
      Iteration2: ExternalInput "2.mat", ExternalInput "2.mat"
      Iteration3: ExternalInput "3.mat", ExternalInput "3.mat"